# Grasshopper definition vicc_metahopper.gh (Grasshopper 1.0.7)
# plug-ins: MetaHopper

crv = Curve([<curve referenced from the Rhino model> x4])
crv_2 = Curve([<curve referenced from the Rhino model> x4])
# Metahopper
join = JoinCurves(Curves=crv, Preserve=False)
# DataTree
join_2 = JoinCurves(Curves=crv_2, Preserve=False)
disc = Discontinuity(Curve=join, Level=1)  # -> graft(Points), Parameters
disc_2 = Discontinuity(Curve=join_2, Level=1)  # -> graft(Points), Parameters
eval = EvaluateCurve(Curve=join, Parameter=graft(disc.Parameters))  # -> Point, Tangent, Angle
shatter = Shatter(Curve=join, Parameters=disc.Parameters)
eval_2 = EvaluateCurve(Curve=join_2, Parameter=graft(disc_2.Parameters))  # -> Point, Tangent, Angle
shatter_2 = Shatter(Curve=join_2, Parameters=disc_2.Parameters)
crv_cp = CurveClosestPoint(Point=disc.Points, Curve=shatter)  # -> Point, Parameter, Distance
crv_cp_2 = CurveClosestPoint(Point=disc_2.Points, Curve=shatter_2)  # -> Point, Parameter, Distance
smaller = SmallerThan(FirstNumber=crv_cp.Distance, SecondNumber="1e-2")  # -> SmallerThan, OrEqualTo
smaller_2 = SmallerThan(FirstNumber=crv_cp_2.Distance, SecondNumber="1e-2")  # -> SmallerThan, OrEqualTo
cull = CullPattern(List=shatter, CullPattern=smaller.SmallerThan)
cull_2 = CullPattern(List=shatter_2, CullPattern=smaller_2.SmallerThan)
len = Length(Curve=shatter)
crv_cp_3 = CurveClosestPoint(Point=disc.Points, Curve=cull)  # -> Point, Parameter, Distance
division = Division(A=len, B="1000")
len_2 = Length(Curve=shatter_2)
crv_cp_4 = CurveClosestPoint(Point=disc_2.Points, Curve=cull_2)  # -> Point, Parameter, Distance
eval_3 = EvaluateCurve(Curve=cull, Parameter=crv_cp_3.Parameter)  # -> Point, Tangent, Angle
round = Round(Number=division)  # -> Nearest, Floor, Ceiling
division_2 = Division(A=len_2, B="1000")
eval_4 = EvaluateCurve(Curve=cull_2, Parameter=crv_cp_4.Parameter)  # -> Point, Tangent, Angle
xy = XYPlane(Origin=disc.Points)
line = LineSDL(Start=eval_3.Point, Direction=eval_3.Tangent, Length=1)
round_2 = Round(Number=division_2)  # -> Nearest, Floor, Ceiling
divide = DivideCurve(Curve=shatter, Count=round.Nearest, Kinks=False)  # -> Points, Tangents, Parameters
xy_2 = XYPlane(Origin=disc_2.Points)
line_2 = LineSDL(Start=eval_4.Point, Direction=eval_4.Tangent, Length=1)
midpt = CurveMiddle(Curve=line)
align = AlignPlane(Plane=xy, Direction=eval.Tangent)  # -> Plane, Angle
align_2 = AlignPlane(Plane=divide.Points, Direction=divide.Tangents)  # -> Plane, Angle
divide_2 = DivideCurve(Curve=shatter_2, Count=round_2.Nearest, Kinks=False)  # -> Points, Tangents, Parameters
midpt_2 = CurveMiddle(Curve=line_2)
align_3 = AlignPlane(Plane=xy_2, Direction=eval_2.Tangent)  # -> Plane, Angle
avr = Average(Input=midpt)
align_4 = AlignPlane(Plane=divide_2.Points, Direction=divide_2.Tangents)  # -> Plane, Angle
panel = Panel("""0
-1""")
avr_2 = Average(Input=midpt_2)
cull_i = CullIndex(List=align_2.Plane, Indices=panel, Wrap=True)
subtraction = Subtraction(A=avr, B=disc.Points)
panel_2 = Panel("""0
-1""")
cull_i_2 = CullIndex(List=align_4.Plane, Indices=panel_2, Wrap=True)
subtraction_2 = Subtraction(A=avr_2, B=disc_2.Points)
align_5 = AlignPlane(Plane=align.Plane, Direction=subtraction)  # -> Plane, Angle
align_6 = AlignPlane(Plane=align_3.Plane, Direction=subtraction_2)  # -> Plane, Angle
expression = Expression(x=align_5.Angle, Expression="(π-x*2)*(180/π)")
expression_2 = Expression(x=align_6.Angle, Expression="(π-x*2)*(180/π)")
format = Format(Format="{0:0}", Culture=127, Data0=expression)
format_2 = Format(Format="angled{0:0}", Culture=127, Data0=expression_2)
entwine = Entwine(Branch00=cull_i_2, Branch01=align_6.Plane, FlattenInputs=True)
entwine_2 = Entwine(Branch00="straight", Branch01=format_2, FlattenInputs=True)
long = LongestList(ListA=entwine, ListB=entwine_2, PaddingMode=2)  # -> ListA, ListB
# 読み込んだ外周線
crv_3 = Curve(crv_2)
pt = Point(long.ListA)
objdet = ObjectDetails(Object=crv_3)  # -> Referenced, Available, Name, Layer, Colour, Guid
colom = CollisionOneMany(Collider=pt, Obstacles=crv_3)  # -> Collision, Index
item = ListItem(List=objdet.Name, Index=colom.Index, Wrap=True)
connected = GetConnectedObjects(Objects=[cull_i, align_5.Plane])
straight = Geometry([<point referenced from the Rhino model>, <curve referenced from the Rhino model> x2, <brep referenced from the Rhino model>])
angled90 = Geometry([<point referenced from the Rhino model>, <curve referenced from the Rhino model> x2, <brep referenced from the Rhino model>])
angled270 = Geometry([<point referenced from the Rhino model>, <curve referenced from the Rhino model> x2, <brep referenced from the Rhino model>])
angled120 = Geometry([<point referenced from the Rhino model>, <curve referenced from the Rhino model> x2, <brep referenced from the Rhino model>])
angled240 = Geometry([<point referenced from the Rhino model>, <curve referenced from the Rhino model> x2, <brep referenced from the Rhino model>])
paramdata = GetParamData(Param=connected)  # -> Data, DataPaths
# 読み込んだ外周線
crv_4 = Curve(crv)
entwine_3 = Entwine(Branch00=straight, Branch01=angled90, Branch02=angled270, Branch03=angled120, Branch04=angled240, FlattenInputs=True)
unwrap = UnwrapList(WrappedData=paramdata.Data)
panel_3 = Panel("""straight
angled90
angled270
angled120
angled240""")
tstat = TreeStatistics(Tree=entwine_3)  # -> Paths, Length, Count
pt_2 = Point(unwrap)
objdet_2 = ObjectDetails(Object=crv_4)  # -> Referenced, Available, Name, Layer, Colour, Guid
colom_2 = CollisionOneMany(Collider=pt_2, Obstacles=crv_4)  # -> Collision, Index
groups = GetGroups()  # -> Groups, GroupStyles, Nickname, Color
keysearch = KeyValueSearch(Keys=panel_3, Values=tstat.Paths, Search=long.ListB)
item_2 = ListItem(List=objdet_2.Name, Index=colom_2.Index, Wrap=True)
objfromgroup = GetObjectsInGroup(Group=groups.Groups)
# フィルタリング目的なので
# エラーが出る
branch = TreeBranch(Tree=entwine_3, Path=keysearch, MaintainPaths=False)
object_info = ObjectInfo(Objects=objfromgroup)  # -> Name, NickName, Type, Pivot, Bounds, Value, Enabled, Preview
object_info_2 = ObjectInfo(Objects=connected)  # -> Name, NickName, Type, Pivot, Bounds, Value, Enabled, Preview
panel_4 = Panel("""north
east
west
south""")
srf = Surface(branch)
pt_3 = Point(branch)
mindex = MemberIndex(Set=flatten(item), Member=panel_4)  # -> Index, Count
intersection = SetIntersection(SetA=object_info.Pivot, SetB=object_info_2.Pivot)
match = MatchTree(Tree=graft(groups.Groups), Guide=intersection)
clean = CleanTree(RemoveNulls=True, RemoveInvalid=True, RemoveEmpty=False, Tree=srf)
clean_2 = CleanTree(RemoveNulls=True, RemoveInvalid=True, RemoveEmpty=False, Tree=pt_3)
clean_3 = CleanTree(RemoveNulls=True, RemoveInvalid=True, RemoveEmpty=True, Tree=intersection, SynchronousTree1=match)  # -> flatten(Tree), flatten(SynchronousTree1)
panel_5 = Panel("""straight
angled90
angled270
angled120
angled240""")
item_3 = ListItem(List=flatten(long.ListB), Index=mindex.Index, Wrap=True)
keysearch_2 = KeyValueSearch(Keys=clean_3.Tree, Values=clean_3.SynchronousTree1, Search=object_info_2.Pivot)
mindex_2 = MemberIndex(Set=item_3, Member=panel_5)  # -> Index, Count
objfromgroup_2 = GetObjectsInGroup(Group=keysearch_2)
orient = Orient(Geometry=clean, Source=clean_2, Target=graft(long.ListA))  # -> Geometry, Transform
format_3 = Format(Format="・{1} : {0}", Culture=127, Data0=mindex_2.Count, Data1=panel_5)
param_info = ParamInfo(Param=objfromgroup_2)  # -> Name, NickName, DataType, Pivot, Bounds, Sources, Recipients, Kind
join_3 = TextJoin(Text=format_3)  # -> flatten(Result)
panel_6 = Panel("""{2} : {1}
{0}""")
format_4 = Format(Format=panel_6, Culture=127, Data0=join_3, Data1=mindex.Count, Data2=panel_4)
panel_7 = Panel(format_4)
keysearch_3 = KeyValueSearch(Keys=param_info.NickName, Values=objfromgroup_2, Search="角度")
paramdata_2 = GetParamData(Param=keysearch_3)  # -> Data, DataPaths
unwrap_2 = UnwrapList(WrappedData=paramdata_2.Data)
format_5 = Format(Format="{1}{0}", Culture=127, Data0=unwrap_2, Data1=graft(object_info_2.NickName))
panel_8 = Panel("""north
east
west
south""")
long_2 = LongestList(ListA=format_5, ListB=unwrap, PaddingMode=2)  # -> ListA, ListB
mindex_3 = MemberIndex(Set=flatten(item_2), Member=panel_8)  # -> Index, Count
straight_2 = Geometry([<point referenced from the Rhino model>, <curve referenced from the Rhino model> x2, <brep referenced from the Rhino model>])
angled90_2 = Geometry([<point referenced from the Rhino model>, <curve referenced from the Rhino model> x2, <brep referenced from the Rhino model>])
angled270_2 = Geometry([<point referenced from the Rhino model>, <curve referenced from the Rhino model> x2, <brep referenced from the Rhino model>])
angled120_2 = Geometry([<point referenced from the Rhino model>, <curve referenced from the Rhino model> x2, <brep referenced from the Rhino model>])
angled240_2 = Geometry([<point referenced from the Rhino model>, <curve referenced from the Rhino model> x2, <brep referenced from the Rhino model>])
panel_9 = Panel("""straight
angled90
angled270
angled120
angled240""")
item_4 = ListItem(List=flatten(long_2.ListA), Index=mindex_3.Index, Wrap=True)
connected_2 = GetConnectedObjects(Objects=[straight_2, angled90_2, angled270_2, angled120_2, angled240_2])
mindex_4 = MemberIndex(Set=item_4, Member=panel_9)  # -> Index, Count
param_info_2 = ParamInfo(Param=connected_2)  # -> Name, NickName, DataType, Pivot, Bounds, Sources, Recipients, Kind
format_6 = Format(Format="・{1} : {0}", Culture=127, Data0=mindex_4.Count, Data1=panel_9)
keysearch_4 = KeyValueSearch(Keys=param_info_2.NickName, Values=connected_2, Search=long_2.ListA)
join_4 = TextJoin(Text=format_6)  # -> flatten(Result)
panel_10 = Panel("""{2} : {1}
{0}""")
paramdata_3 = GetParamData(Param=keysearch_4)  # -> Data, DataPaths
format_7 = Format(Format=panel_10, Culture=127, Data0=join_4, Data1=mindex_3.Count, Data2=panel_8)
# フィルタリング目的なので
# エラーが出る
unwrap_3 = UnwrapList(WrappedData=paramdata_3.Data)
panel_11 = Panel(format_7)
srf_2 = Surface(unwrap_3)
pt_4 = Point(unwrap_3)
clean_4 = CleanTree(RemoveNulls=True, RemoveInvalid=True, RemoveEmpty=False, Tree=srf_2)
clean_5 = CleanTree(RemoveNulls=True, RemoveInvalid=True, RemoveEmpty=False, Tree=pt_4)
orient_2 = Orient(Geometry=clean_4, Source=clean_5, Target=graft(long_2.ListB))  # -> Geometry, Transform
